# Grasshopper definition Flower.gh (Grasshopper 1.0.7)
# plug-ins: NPKG

r1 = Input()
default = SetDefault(Input=r1, Default="12")
cir = Circle(Plane=PlaneXY(0, 0, 0), Radius=default)
r2 = Input()
divide = DivideCurve(Curve=cir, Count=10, Kinks=False)  # -> Points, Tangents, Parameters
c_script = CSharpScript()  # -> out, A
# ---------- c_script: C# usings ----------
using Grasshopper.Kernel.Special;
# ---------- c_script: C# ----------
    GH_ClusterInputHook[] inputs = Instances.ActiveCanvas.Document.ClusterInputHooks();
# ---------- end c_script ----------
default_2 = SetDefault(Input=r2, Default="12")
panel = Panel(c_script.A)
cir_2 = Circle(Plane=divide.Points, Radius=default_2)
C = Circle(cir_2)
